% Simulink data dictionary LIB_p2d_dictionary.sldd

n1 = 5
n2 = 2
n3 = 5
n4 = 5
ord = 2
MatC = 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

Const = struct(
  Ac=0.06577752,
  I_1C=2.6,
  Ln=9.75e-5,
  Ls=1.7e-5,
  Lp=7.1e-5,
  epsilonen=0.4,
  epsilones=0.4,
  epsilonep=0.3,
  brugn=1.5,
  brugs=1.5,
  brugp=1.5,
  Fra=96487,
  R=8.3143,
  Rn=8.614e-6,
  Rp=1.688e-5,
  epsilonsn=0.543,
  epsilonsp=0.597819,
  sigman=100,
  sigmap=3.8,
  ce0=1200,
  an=189110.7,
  ap=106247.5,
  Sn=1.212826,
  Sp=0.4961973,
  dlnfdce=0,
  csnmax=30556,
  cspmax=51555,
  xn0=0.002,
  xp0=1,
  xnf=0.942,
  xpf=0.27,
  alphan=0.5,
  alphap=0.5,
  ienref=29.86708,
  iepref=1.598578,
  Earn=0,
  Earp=0,
  Rfilmn=0.1115,
  Rfilmp=0,
  Dsnref=1.3134e-14,
  Dspref=9.6117e-14,
  Eadn=0,
  Eadp=0,
  Tref=298,
  Qn=2.680656,
  Qp=2.816009,
  Qr=2.680656,
  Dl=5.6937e-11,
  tplus=0.363,
  Eadl=20000,
  Rex=0.001,
  Vnom=3.75,
  Pnom=148.2269)

dt = 0.5